# Dynamo graph taec_GetFromNotion.dyn (Dynamo 2.5.0.7460)
# packages: Rhythm 2020.7.25

get_data_from_notion = Python()
# ---------- get_data_from_notion.python (77 lines) ----------
from System.Net import WebRequest
from System.Text import ASCIIEncoding
from System.IO import StreamReader
from System.Net import ServicePointManager
from System.Net import SecurityProtocolType
from System.Net import WebException
import time, json

# Functions
def http(method, url, data_string=None, header={}, retry=3):
    ServicePointManager.SecurityProtocol |= SecurityProtocolType.Tls11 | SecurityProtocolType.Tls12
    request = WebRequest.Create(url)
    request.UseDefaultCredentials = True
    request.Method = method
    request.ContentLength = 0
    
    for k,v in header.items():
        request.Headers.Add(k,v)
    
    if data_string:
        request.ContentType = "application/json"
        encoding = ASCIIEncoding()
        data = encoding.GetBytes(data_string)
        request.ContentLength = data.Length
        stream = request.GetRequestStream()
        stream.Write(data, 0, data.Length)
        stream.Close()

    try:
        response = request.GetResponse()
        print (response.StatusDescription)
        dataStream = response.GetResponseStream()
        reader = StreamReader(dataStream)
    
        responseFromServer = reader.ReadToEnd()
            
        reader.Close()
        dataStream.Close()
        response.Close()
        return responseFromServer

    except WebException as e : 
        if e.Response.StatusDescription == "Not Found" and retry>0:
            time.sleep(10)
            return http(method, url, data_string, header, retry-1)

        print (e.Response.StatusDescription)
        dataStream = e.Response.GetResponseStream()
        reader = StreamReader(dataStream)
    
        responseFromServer = reader.ReadToEnd()
        print (responseFromServer)
    
        reader.Close()
        dataStream.Close()

# この行の下にコードを配置します
# URL
database_id = "**"
url = "https://api.notion.com/v1/databases/{}/query/".format(database_id)
# Token
token = "Bearer **"
# headers
headers = {
			'Authorization': token,
            'Notion-Version': "2021-05-13"
			}
# body
values = {}
data = json.dumps(values)

#run webAPI
res = http("POST",url,data,headers)
objects = json.loads(res)["results"]

# 出力を OUT 変数に割り当てます。
OUT = res
# ----------------------------------------
watch = Watch(get_data_from_notion)
ʳʰʸᵗʰᵐ_system_sendtoclipboard = Rhythm.Helpers.System.SendToClipboard(str=watch)  # frozen
extract_data_from_json = Python(IN[0]=get_data_from_notion)
# ---------- extract_data_from_json.python (20 lines) ----------
import time, json

# このノードへの入力は、リスト形式で IN 変数に格納されます。
res = IN[0]

# この行の下にコードを配置します
objects = json.loads(res)["results"]

data = []
for obj in objects:
	props = obj["properties"]
	record = {
		"id":props["id"]["number"],
		"x":props["x"]["number"],
		"y":props["y"]["number"]
	}
	data.append(record)

# 出力を OUT 変数に割り当てます。
OUT = data
# ----------------------------------------
update_instances_by_data = Python(IN[0]=extract_data_from_json)
# ---------- update_instances_by_data.python (41 lines) ----------
import clr
clr.AddReference('RevitAPI')
from Autodesk.Revit.DB import*

clr.AddReference('RevitServices')
from RevitServices.Persistence import DocumentManager
from RevitServices.Transactions import TransactionManager
uiapp = DocumentManager.Instance.CurrentUIApplication
app = uiapp.Application

#input assigned the IN variable
data = IN[0]


#default document set to DocumentManager.Instance.CurrentDBDocument
doc = DocumentManager.Instance.CurrentDBDocument

#core data processing
def update_instance(record):
	#パラメータセット
	TransactionManager.Instance.EnsureInTransaction(doc)
	
	elem = doc.GetElement(ElementId(record["id"]))
	dxyz = XYZ(
		record["x"]/304.8-elem.Location.Point[0],
		record["y"]/304.8-elem.Location.Point[1],
		0
	)
	ElementTransformUtils.MoveElement(doc,elem.Id,dxyz)
	
	TransactionManager.Instance.ForceCloseTransaction()
	
	return elem
	
a = []
for record in data:
	b = update_instance(record)
	a.append(b)

#output assigned the OUT variable
OUT = a
# ----------------------------------------
