# Dynamo graph taec_Send2Notion.dyn (Dynamo 2.5.0.7460)

family_types = FamilyTypes("F1:F1")
all_elements_of_family_type = ElementsOfFamilyType(Family_Type=family_types)
extract_data = Python(IN[0]=all_elements_of_family_type)
# ---------- extract_data.python (41 lines) ----------
import clr

clr.AddReference('RevitAPI')
from Autodesk.Revit.DB import *
from Autodesk.Revit.DB.Structure import *

clr.AddReference('RevitAPIUI')
from Autodesk.Revit.UI import *

clr.AddReference('System')
from System.Collections.Generic import List

clr.AddReference('RevitNodes')
import Revit
clr.ImportExtensions(Revit.GeometryConversion)
clr.ImportExtensions(Revit.Elements)

clr.AddReference('RevitServices')
import RevitServices
from RevitServices.Persistence import DocumentManager
from RevitServices.Transactions import TransactionManager

doc = DocumentManager.Instance.CurrentDBDocument
uidoc=DocumentManager.Instance.CurrentUIApplication.ActiveUIDocument

# このノードへの入力は、リスト形式で IN 変数に格納されます。
elems = IN[0]

# この行の下にコードを配置します
data = []

for elem in elems:
	dict = {
		"id":elem.Id,
		"x":round(elem.Location.X),
		"y":round(elem.Location.Y)
	}
	data.append(dict)

# 出力を OUT 変数に割り当てます。
OUT = data
# ----------------------------------------
send_data_to_notion = Python(IN[0]=extract_data)
# ---------- send_data_to_notion.python (93 lines) ----------
from System.Net import WebRequest
from System.Text import ASCIIEncoding
from System.IO import StreamReader
from System.Net import ServicePointManager
from System.Net import SecurityProtocolType
from System.Net import WebException
import time, json

# Functions
def http(method, url, data_string=None, header={}, retry=3):
    ServicePointManager.SecurityProtocol |= SecurityProtocolType.Tls11 | SecurityProtocolType.Tls12
    request = WebRequest.Create(url)
    request.UseDefaultCredentials = True
    request.Method = method
    request.ContentLength = 0
    
    for k,v in header.items():
        request.Headers.Add(k,v)
    
    if data_string:
        request.ContentType = "application/json"
        encoding = ASCIIEncoding()
        data = encoding.GetBytes(data_string)
        request.ContentLength = data.Length
        stream = request.GetRequestStream()
        stream.Write(data, 0, data.Length)
        stream.Close()

    try:
        response = request.GetResponse()
        print (response.StatusDescription)
        dataStream = response.GetResponseStream()
        reader = StreamReader(dataStream)
    
        responseFromServer = reader.ReadToEnd()
            
        reader.Close()
        dataStream.Close()
        response.Close()
        return responseFromServer

    except WebException as e : 
        if e.Response.StatusDescription == "Not Found" and retry>0:
            time.sleep(10)
            return http(method, url, data_string, header, retry-1)

        print (e.Response.StatusDescription)
        dataStream = e.Response.GetResponseStream()
        reader = StreamReader(dataStream)
    
        responseFromServer = reader.ReadToEnd()
        print (responseFromServer)
    
        reader.Close()
        dataStream.Close()

# このノードへの入力は、リスト形式で IN 変数に格納されます。
dicts = IN[0]

# この行の下にコードを配置します

# URL
url = "https://api.notion.com/v1/pages"
# Token
token = "Bearer **"
# headers
headers = {
            'Authorization': token,
            'Notion-Version': "2021-05-13",
            }

for dict in dicts:
    values = {
        "parent": {"database_id": "**"},
        "properties": {
            "id": {
                "number":dict["id"]
            },
            "x": {
                "number":dict["x"]
            },
            "y": {
                "number":dict["y"]
            },
        }
        }
    # bodyを文字列化
    data = json.dumps(values)
    # POST
    http("POST",url,data,headers)

# 出力を OUT 変数に割り当てます。
OUT = 0
# ----------------------------------------
